# Grasshopper definition MixedUseLiving_Automation.gh (Grasshopper 1.0.7)
# Copyright: SSA
# plug-ins: LunchBox, Kangaroo2 Components

# ----
# SITE
# AMENITIES
# 2BHK
# 3BHK
crv = Curve([<curve referenced from the Rhino model> x4])
crv_2 = Curve(<curve referenced from the Rhino model>)
crv_3 = Curve(<curve referenced from the Rhino model>)
crv_4 = Curve(<curve referenced from the Rhino model>)

boundary = BoundarySurfaces(Edges=crv_3)
md_slider = MDSlider(SliderMode=0, slider_value=Point(0.5, 0.5, 0.5), x_domain=Domain(0, 1), y_domain=Domain(0, 1), z_domain=Domain(0, 1))
# WALKING DISTANCE
number_slider = Slider(200, range=0..1000)
area = Area(Geometry=crv)  # -> Area, flatten(Centroid)
iso = IsoCurve(Surface=reparameterize(boundary), UVPoint=md_slider)  # -> UIsocurve, VIsocurve
number_slider_2 = Slider(9, range=0..100)
len = Length(Curve=iso.VIsocurve)
len_2 = Length(Curve=iso.UIsocurve)
xy = XYPlane(Origin=area.Centroid)
multiplication = Multiplication(A=number_slider, B=Slider(0.87, range=0..1.5))
subtraction = Subtraction(A=len, B=multiplication)
subtraction_2 = Subtraction(A=len_2, B=multiplication)
division = Division(A=subtraction_2, B=number_slider_2)
division_2 = Division(A=subtraction, B=number_slider_2)
int = Integer(division)
int_2 = Integer(division_2)
range = Range(Domain=subtraction, Steps=int_2)
range_2 = Range(Domain=subtraction_2, Steps=int)
division_3 = Division(A=multiplication, B="2")
division_4 = Division(A=multiplication, B="2")
addition = Addition(A=range_2, B=division_3)
addition_2 = Addition(A=range, B=division_4)
pt = ConstructPoint(XCoordinate=addition, YCoordinate=graft(addition_2), ZCoordinate=0)  # -> flatten(Point)
number_slider_3 = Slider(849, range=0..1000)
lng = ListLength(List=crv)
number_slider_4 = Slider(745, range=0..1000)
lng_2 = ListLength(List=pt)
int_3 = Integer(lng)
pi = Pi(Factor=Slider(2, range=0..10))
random = Random(Range=lng_2, Number=int_3, Seed=number_slider_3)
item = ListItem(List=pt, Index=random, Wrap=True)
random_2 = Random(Range=pi, Number=lng, Seed=number_slider_4)
Z = UnitZ(Factor=Slider(3, range=0..10))
pl = ConstructPlane(Origin=item, XAxis=Vector(1, 0, 0), YAxis=Vector(0, 1, 0))
cir = Circle(Plane=item, Radius=number_slider)
runion = RegionUnion(Curves=cir)
prot = RotatePlane(Plane=pl, Angle=random_2)
rdiff = RegionDifference(CurvesA=crv_3, CurvesB=runion)
orient = Orient(Geometry=crv, Source=xy, Target=prot)  # -> Geometry, Transform
area_2 = Area(Geometry=orient.Geometry)  # -> Area, Centroid
voronoi = Voronoi(Points=area_2.Centroid, Boundary=crv_3, BruteForceOverride=False)
area_3 = Area(Geometry=rdiff)  # -> Area, Centroid
# UNIT ROW SPACING
number_slider_5 = Slider(14, range=0..100)
ma = MassAddition(Input=area_3.Area)  # -> Result, PartialResults
offset = OffsetCurve(Curve=voronoi, Distance=number_slider_5, Plane=PlaneXY(0, 0, 0), Corners=1)
galapagos = Galapagos(fitness=addition_3, gene=[number_slider_3, number_slider_4])
panel = Panel("""0
1""")
dup = DuplicateData(Data=number_slider_5, Number="10", Order=True)
dup_2 = DuplicateData(Data=Slider(26, range=0..100), Number="10", Order=True)
weave = Weave(Pattern=panel, Stream0=dup, Stream1=dup_2, NullGaps=False)
consec = ConsecutiveDomains(Numbers=weave, Additive=True)
dedomain = DeconstructDomain(Domain=consec)  # -> Start, End
offset_2 = OffsetCurve(Curve=offset, Distance=dedomain.Start, Plane=PlaneXY(0, 0, 0), Corners="1")  # -> simplify(Curve)
area_4 = Area(Geometry=offset_2)  # -> Area, Centroid
path_mapper = PathMapper(offset_2, source="{A;B}", target="{A}")
path_mapper_2 = PathMapper(area_4.Area, source="{A;B}", target="{A}")
null = NullItem(Item=path_mapper_2)  # -> NullFlags, InvalidFlags, Description
not = GateNot(A=null.InvalidFlags)
cull = CullPattern(List=path_mapper_2, CullPattern=not)
cull_2 = CullPattern(List=path_mapper, CullPattern=not)
tstat = TreeStatistics(Tree=cull)  # -> Paths, Length, Count
series = Series(Start=0, Step=1, Count=tstat.Length)
sort = SortList(Keys=cull, ValuesA=series)  # -> Keys, ValuesA
item_2 = ListItem(List=sort.ValuesA, Index=0, Wrap=True)
split = SplitList(List=cull_2, Index=item_2)  # -> ListA, ListB
crv_5 = Curve(split.ListA)
rev = ReverseList(List=crv_5)
cull_i = CullIndex(List=rev, Indices="0", Wrap=True)
# UNIT BLOCK SPACING
number_slider_6 = Slider(17, range=0..100)
explode = Explode(Curve=cull_i, Recursive=True)  # -> simplify(Segments), Vertices
# AMENITY OFFSET
number_slider_7 = Slider(23, range=0..100)
graft = GraftTree(Tree=explode.Segments, IncludeEmptyLists=True, IncludeNullItems=True)
len_3 = Length(Curve=graft)
division_5 = Division(A=len_3, B=number_slider_6)
item_3 = ListItem(List=rev, Index=0, Wrap=True)
offset_3 = OffsetCurve(Curve=orient.Geometry, Distance=number_slider_7, Plane=PlaneXY(0, 0, 0), Corners=1)  # -> simplify(Curve)
int_4 = Integer(division_5)
range_3 = Range(Domain=Domain(0, 1), Steps=int_4)
cull_i_2 = CullIndex(List=range_3, Indices="0", Wrap=True)
area_5 = Area(Geometry=item_3)  # -> Area, Centroid
eval = EvaluateCurve(Curve=reparameterize(graft), Parameter=cull_i_2)  # -> simplify(Point), simplify(Tangent), Angle
path_mapper_3 = PathMapper(eval.Tangent, source="{A;B;C}", target="{A}")
path_mapper_4 = PathMapper(eval.Point, source="{A;B;C}", target="{A}")
con = DelaunayEdges(Points=flatten(area_5.Centroid), Plane=PlaneXY(0, 0, 0))  # -> Connectivity, Edges
boundary_2 = BoundarySurfaces(Edges=item_3)
incurve = PointInCurve(Point=path_mapper_4, Curve=offset_3)  # -> Relationship, Point
dupln = RemoveDuplicateLines(Lines=flatten(con.Edges), Tolerance=0.01)
equals = Equality(FirstNumber=incurve.Relationship, SecondNumber="0")  # -> Equality, Inequality
cull_3 = CullPattern(List=path_mapper_4, CullPattern=equals.Equality)
graft_2 = GraftTree(Tree=cull_3, IncludeEmptyLists=True, IncludeNullItems=True)
cull_4 = CullPattern(List=path_mapper_3, CullPattern=equals.Equality)
# UNIT SPLIT RATIO
crossref = CrossReference(ListA=dupln, ListB=graft_2, CrossMode=1)  # -> ListA, ListB
# PEDESTRIAN PATH HALF WIDTH
number_slider_8 = Slider(10.5, range=0..100)
pull = PullPoint(Point=crossref.ListB, Geometry=crossref.ListA, ClosestOnly=True)  # -> ClosestPoint, Distance
smaller = SmallerThan(FirstNumber=pull.Distance, SecondNumber=number_slider_8)  # -> SmallerThan, OrEqualTo
lng_3 = ListLength(List=cull_3)  # -> flatten(Length)
ma_2 = MassAddition(Input=smaller.SmallerThan)  # -> Result, PartialResults
partition = PartitionList(List=flatten(ma_2.Result), Size=lng_3)
not_2 = GateNot(A=partition)
Z_2 = UnitZ(Factor=1)
cull_5 = CullPattern(List=cull_3, CullPattern=not_2)
cull_6 = CullPattern(List=cull_4, CullPattern=not_2)
xprod = CrossProduct(VectorA=cull_6, VectorB=Z_2, Unitize=False)  # -> Vector, Length
pl_2 = ConstructPlane(Origin=cull_5, XAxis=cull_6, YAxis=xprod.Vector)
area_6 = Area(Geometry=crv_4)  # -> Area, Centroid
area_7 = Area(Geometry=crv_2)  # -> Area, Centroid
xy_2 = XYPlane(Origin=area_6.Centroid)
xy_3 = XYPlane(Origin=area_7.Centroid)
randomsplit = RandomSplitList(MasterList=pl_2, Seed=2, Split=Slider(0.4, range=0..1))  # -> ListA, ListB

orient_2 = Orient(Geometry=crv_4, Source=xy_2, Target=randomsplit.ListA)  # -> Geometry, Transform
orient_3 = Orient(Geometry=crv_2, Source=xy_3, Target=randomsplit.ListB)  # -> Geometry, Transform

boundary_3 = BoundarySurfaces(Edges=orient_2.Geometry)
boundary_4 = BoundarySurfaces(Edges=orient_3.Geometry)
button = Button()
Z_3 = UnitZ(Factor=Slider(6, range=0..10))
extr = Extrude(Base=boundary_3, Direction=Z_3)
extr_2 = Extrude(Base=boundary_4, Direction=Z_3)
bake = ObjectBake(
    BakeToggle=button,
    GeometryObjects=extr_2,
    Layer="3BHK",
    ObjectName="GH_Obj",
    ObjectColor=RGB(255, 255, 255),
    LayerColor=RGB(255, 255, 255))
bake_2 = ObjectBake(
    BakeToggle=button,
    GeometryObjects=offset,
    Layer="Road",
    ObjectName="GH_Obj",
    ObjectColor=RGB(255, 255, 255),
    LayerColor=RGB(255, 255, 255))
bake_3 = ObjectBake(
    BakeToggle=button,
    GeometryObjects=extr,
    Layer="2BHK",
    ObjectName="GH_Obj",
    ObjectColor=RGB(255, 255, 255),
    LayerColor=RGB(255, 255, 255))
bake_4 = ObjectBake(
    BakeToggle=button,
    GeometryObjects=boundary_2,
    Layer="Park",
    ObjectName="GH_Obj",
    ObjectColor=RGB(255, 255, 255),
    LayerColor=RGB(255, 255, 255))

number_slider_9 = Slider(8, range=0..24)
file_path = FilePath("C:\Users\dewag\Downloads\CAN_ON_Toronto.City.715080_CWEC2016.epw")
panel_2 = Panel(file_path)
importepw = Ladybug_ImportEpw(epwFile=file_path)  # -> Output, latitude, location, dryBulbTemperature, dewPointTemperature, relativeHumidity, windSpeed, windDirection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; plug-in component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
analysisperiod = Ladybug_AnalysisPeriod(
    fromMonth=Slider(1, range=0..12),
    fromDay=Slider(1, range=0..31),
    toMonth=Slider(12, range=0..12),
    toDay=Slider(31, range=0..31))  # -> out, analysisPeriod; plug-in component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
ladybug = Ladybug_Ladybug()  # -> yay; plug-in component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
sunpath = Ladybug_SunPath(
    location=importepw.location,
    hour=12,
    day=21,
    month=12,
    timeStep=1,
    analysisPeriod=analysisperiod.analysisPeriod,
    dailyOrAnnualSunPath=True)  # -> out, sunVectors, sunAltitudes, sunAzimuths, port, sunSpheresMesh, sunPathCrvs, compassCrvs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; plug-in component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
gencumulativeskymtx = Ladybug_GenCumulativeSkyMtx(epwFile=file_path, skyDensity=0, useOldRes=True, runIt=Toggle(True))  # -> readMe, cumulativeSkyMtx; plug-in component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
selectskymtx = Ladybug_selectSkyMtx(
    cumulativeSkyMtx=gencumulativeskymtx.cumulativeSkyMtx,
    analysisPeriod=analysisperiod.analysisPeriod,
    removeDiffuse=False,
    removeDirect=False)  # -> readMe, selectedSkyMtx; plug-in component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
swatch = ColourSwatch(SwatchColor=RGB(0, 0, 0))
brep = Brep([<brep referenced from the Rhino model> x132])
toggle = BooleanToggle(True)
boundary_surfaces = BoundarySurfaces(Edges=orient.Geometry)

extr_3 = Extrude(Base=boundary_surfaces, Direction=Z)

brep_2 = Brep(extr_3)
sunlighthoursanalysis = Ladybug_SunlightHoursAnalysis(
    geometry=flatten(brep_2),
    context=flatten(brep),
    gridSize="4000",
    disFromBase="20",
    sunVectors=flatten(sunpath.sunVectors),
    timeStep=1,
    runIt=Toggle(False))  # -> out, contextMesh, analysisMesh, testPts, testVec, port, sunlightHoursResult, sunlightHoursMesh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; plug-in component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
radiationanalysis = Ladybug_RadiationAnalysis(
    geometry=flatten(brep_2),
    context=flatten(brep),
    gridSize="4000",
    disFromBase="20",
    selectedSkyMtx=flatten(selectskymtx.selectedSkyMtx),
    parallel=toggle,
    runIt=toggle)  # -> readMe, contextMesh, analysisMesh, testPts, testVec, port, radiationResult, radiationMesh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; plug-in component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

division_6 = Division(A=radiationanalysis.totalRadiation, B=Slider(100, range=0..100))
addition_3 = Addition(A=ma.Result, B=division_6)
bake_5 = ObjectBake(
    BakeToggle=button,
    GeometryObjects=extr_3,
    Layer="Amenities",
    ObjectName="GH_Obj",
    ObjectColor=RGB(255, 255, 255),
    LayerColor=RGB(255, 255, 255))
